# Grasshopper definition 240108-number-relation.gh (Grasshopper 1.0.7)

list = ValueList({"标准层", "首层", "其他变异层"}, selected="标准层")
list_2 = ValueList({"标准层", "首层", "其他变异层"}, selected="标准层")
crv = Curve(<curve referenced from the Rhino model>)
list_3 = ValueList({"洋房", "小高", "大高"}, selected="小高")
list_4 = ValueList({"洋房", "小高", "大高"}, selected="大高")
crv_2 = Curve(<curve referenced from the Rhino model>)
户型1 = 户型1(
    高度类别=list_4,
    变异类别=list_2,
    户型套内面积=Slider(90, range=20..200),
    户型非核心筒公摊面积=Slider(20, range=20..200),
    套内精装单方成本=Slider(850, range=0..10000),
    面宽=Slider(12, range=0..12),
    进深=Slider(12, range=0..12),
    户型轮廓线=crv,
    得房率=Slider(0.75, range=0..1))  # -> 户型名_2, 高度类别_3, 变异类别_3, 户型套内面积_3, 户型非核心筒公摊面积_3, 套内精装单方成本_3, 户型轮廓线_3, 得房率_3
户型2 = 户型1(
    高度类别=list_3,
    变异类别=list,
    户型套内面积=Slider(96.12, range=20..200),
    户型非核心筒公摊面积=Slider(20, range=20..200),
    套内精装单方成本=Slider(1000, range=0..10000),
    面宽=Slider(12, range=0..12),
    进深=Slider(12, range=0..12),
    户型轮廓线=crv_2,
    得房率=Slider(0.78, range=0..1))  # -> 户型名_2, 高度类别_3, 变异类别_3, 户型套内面积_3, 户型非核心筒公摊面积_3, 套内精装单方成本_3, 户型轮廓线_3, 得房率_3
crv_3 = Curve(<curve referenced from the Rhino model>)
list_5 = ValueList({"One": 1, "Two": 2, "Three": 2² - 1, "Four": Sqrt(16)}, selected="Two")
area = Area(Geometry=crv_3)  # -> Area, Centroid
其他地上计容建筑面积 = Number()
trigger = Trigger(Interval=-1000, TimerInterval=1000)
用地面积 = Number(area.Area)
住宅地上建筑面积 = Number()
list_6 = ValueList({"One": 1}, selected="One")
规划地上容积率 = Number(Slider(2, range=0..10))
dispatch = Dispatch(List=户型1.户型名_2, DispatchPattern=[True, False])  # -> ListA, ListB
input = DataInput(UpdateDelay=5)
item = ListItem(List=list_6, Index=0, Wrap=True)
gate = StreamGate(Stream=户型2.户型名_2, Gate=0)  # -> Target0, Target1
multiplication = Multiplication(A=用地面积, B=规划地上容积率)
addition = Addition(A=住宅地上建筑面积, B=其他地上计容建筑面积)
c_script = CSharpScript()  # -> Out, A
规划地上建筑面积 = Number(multiplication)
方案地上建筑面积 = Number(addition)
楼型1 = 楼型1()
subtraction = Subtraction(A=规划地上建筑面积, B=方案地上建筑面积)
方案地上建筑面积不足值 = Number(subtraction)

# ==== cluster 户型1
户型非核心筒公摊面积 = ClusterInput()
户型套内面积 = ClusterInput()
面宽 = ClusterInput()
高度类别 = ClusterInput()
套内精装单方成本 = ClusterInput()
变异类别 = ClusterInput()
得房率 = ClusterInput()
户型轮廓线 = ClusterInput()
进深 = ClusterInput()
户型轮廓线_2 = Curve(户型轮廓线)
户型非核心筒公摊面积_2 = Number(户型非核心筒公摊面积)
套内精装单方成本_2 = Integer(套内精装单方成本)
得房率_2 = Number(得房率)
户型套内面积_2 = Number(户型套内面积)
面宽_2 = Number(面宽)
高度类别_2 = Text(高度类别)
进深_2 = Number(进深)
变异类别_2 = Text(变异类别)
户型名 = Text("120小高标准层")
户型轮廓线_3 = ClusterOutput(户型轮廓线_2)
得房率_3 = ClusterOutput(得房率_2)
套内精装单方成本_3 = ClusterOutput(套内精装单方成本_2)
户型套内面积_3 = ClusterOutput(户型套内面积_2)
户型名_2 = ClusterOutput(户型名)
户型非核心筒公摊面积_3 = ClusterOutput(户型非核心筒公摊面积_2)
变异类别_3 = ClusterOutput(变异类别_2)
高度类别_3 = ClusterOutput(高度类别_2)

# ==== cluster 楼型1
标准层个数 = ClusterInput()
变异层1个数 = ClusterInput()
变异层2个数 = ClusterInput()
变异层3个数 = ClusterInput()
标准层个数_2 = Integer(标准层个数)
变异层1个数_2 = Integer(变异层1个数)
变异层2个数_2 = Integer(变异层2个数)
变异层3个数_2 = Integer(变异层3个数)
首层 = Integer()
层数 = Integer()
